# Grasshopper definition 01_circle.gh (Grasshopper 1.0.7)

# ---- group: Construção de um Cilindro apartir de um circulo
construct_point = ConstructPoint(XCoordinate=Slider(10, range=0..10), YCoordinate=Slider(10, range=0..10), ZCoordinate=Slider(1, range=0..10))
circle = Circle(Plane=construct_point, Radius=Slider(5, range=0..10))
unit_z = UnitZ(Factor=Slider(100, range=0..100))
extrude = Extrude(Base=circle, Direction=unit_z)
cap_holes = CapHoles(Brep=extrude)
